# Grasshopper definition centerline.ghx (Grasshopper 1.0.8)

number_slider = Slider(10, range=0..10)
mesh_fork_kevin = Mesh(<mesh referenced from the Rhino model>)
mesh_fill_hole = Mesh(<mesh referenced from the Rhino model>)
mesh_tube = Mesh(<mesh referenced from the Rhino model>)
shrinkwrap = Mesh(<mesh referenced from the Rhino model>)
triremesh = TriRemesh(Geometry=mesh_fork_kevin, Length=number_slider, Iterations=25)  # -> Triangulation, Dual, Creases
curve = Curve([<curve referenced from the Rhino model> x10])
mesh = Mesh(<mesh referenced from the Rhino model>)  # disabled
growthcenter = Python3Script(sections=curve)  # -> out, maximum_inscribed_circle, growth_center; inputs sections: list of Curve
# ---------- growthcenter: Python ----------
#locate file in the same folder
from ghpythonlib.treehelpers import list_to_tree, tree_to_list
from compas_rhino import unload_modules
from compas_rhino.conversions import curve_to_compas, box_to_rhino, point_to_rhino, polyline_to_rhino
from compas.geometry import Polyline, Point, Circle, Frame
import sys
import os

import compas_cgal

print(compas_cgal.__version__)

#get current file path
path = ghenv.Component.OnPingDocument().FilePath
print (path)
#get parent directory of the parent directory
parentdir = os.path.dirname(path)
print (parentdir)
#get src folder which contains classes
dire = os.path.join(parentdir,'src')
print (dire)

sys.path.append(dire)

unload_modules('helpers')
unload_modules('growth_center')

import growth_center as gc
import helpers

curves = [curve_to_compas(s) for s in sections]

bounding_box = [helpers.curve_bounding_box(crv) for crv in curves]
polyline = [Polyline([point_to_rhino(pt) for pt in bbox.points]) for bbox in bounding_box]
box = [polyline_to_rhino(pl) for pl in polyline]

polygon = [crv.to_polygon(n=64) for crv in curves]

maximum_inscribed_circle = [gc.maximum_inscribed_circle(poly) for poly in polygon] 
growth_center = [c.center for c in maximum_inscribed_circle]
# ---------- end growthcenter ----------
mesh_2 = Mesh(triremesh.Triangulation)
triremesh_2 = TriRemesh(Geometry=mesh, Length=number_slider, Iterations=25)  # -> Triangulation, Dual, Creases; disabled
python_3_script = Python3Script(mesh=triremesh_2.Triangulation)  # -> out, cl; inputs mesh: Mesh; disabled
# ---------- python_3_script: Python ----------
#locate file in the same folder
from compas_rhino import unload_modules
from compas_rhino.conversions import mesh_to_compas
import sys
import os

#get current file path
path = ghenv.Component.OnPingDocument().FilePath
print (path)
#get parent directory of the parent directory
parentdir = os.path.dirname(path)
print (parentdir)
#get src folder which contains classes
dire = os.path.join(parentdir,'src')
print (dire)

sys.path.append(dire)

unload_modules('centerline_adv')

from centerline_adv import CenterlineExtractor

c_mesh = mesh_to_compas(mesh)

extractor = CenterlineExtractor(c_mesh)
cl = extractor.compute()

print(cl)
# ---------- end python_3_script ----------
deconstruct_mesh = DeconstructMesh(Mesh=triremesh.Triangulation)  # -> Vertices, Faces, Colours, Normals
compas_draw = COMPASDraw(cg=growthcenter.growth_center)  # -> rg
#   port cg: The COMPAS geometry or datastructure to be drawn.
#   port rg: The Rhino geometry object.
# ---------- compas_draw: Python ----------
# r: compas>=2.8.1
"""
Draws COMPAS geometry in Grasshopper.
"""

from typing import Any

import Grasshopper

from compas.scene import SceneObject


class CompasToRhinoGeometry(Grasshopper.Kernel.GH_ScriptInstance):
    def RunScript(self, cg):
        if not cg:
            return None

        return SceneObject(item=cg).draw()
# ---------- end compas_draw ----------
compas_draw_2 = COMPASDraw(cg=growthcenter.maximum_inscribed_circle)  # -> rg; same code as compas_draw
compas_draw_3 = COMPASDraw(cg=python_3_script.cl)  # -> rg; disabled; same code as compas_draw
preprocess = Python3Script(mesh=triremesh.Triangulation)  # -> out, branch, mesh_origin, bounding_box, is_fork; inputs mesh: Mesh
# ---------- preprocess: Python ----------
#! python 3
# venv: forkwork
# r: compas, compas_cgal

#locate file in the same folder
from compas_rhino import unload_modules
from compas_rhino.conversions import mesh_to_compas, vector_to_rhino, point_to_rhino
import sys
import os

import compas_cgal

print(compas_cgal.__version__)

#get current file path
path = ghenv.Component.OnPingDocument().FilePath
print (path)
#get parent directory of the parent directory
parentdir = os.path.dirname(path)
print (parentdir)
#get src folder which contains classes
dire = os.path.join(parentdir,'src')
print (dire)

sys.path.append(dire)

unload_modules('branch')
unload_modules('mesh_utils')
unload_modules('graph_utils')
unload_modules('centerline')


from branch import Branch
import mesh_utils
import graph_utils

from compas.geometry import Polyline, Line

c_mesh = mesh_to_compas(mesh)

branch = Branch(c_mesh)
branch.preprocess()
mesh_origin = branch.mesh
bounding_box = branch.bounding_box()
centerline = branch.skeleton_polylines()
is_fork = True if branch.number_of_end_points() > 2 else False
# ---------- end preprocess ----------
curve_2 = Curve(compas_draw_3)  # disabled
panel = Panel(curve_2)  # disabled
list_item = ListItem(List=deconstruct_mesh.Vertices, Index=0, Wrap=True)
compas_draw_4 = COMPASDraw(cg=preprocess.mesh_origin)  # -> rg; same code as compas_draw
compas_draw_5 = COMPASDraw(cg=preprocess.bounding_box)  # -> rg; same code as compas_draw
panel_2 = Panel(preprocess.is_fork)
debug = Python3Script(branch=preprocess.branch)  # -> out, skeleton, skeleton_bifurcation_pt, computed_bifurcation_pt, bifurcation_angle, bifurcation_graph, contours, max_inscribed_circles
# ---------- debug: Python ----------
#locate file in the same folder
from compas_rhino import unload_modules
from compas_rhino.conversions import mesh_to_compas, vector_to_rhino, point_to_rhino
import sys
import os

from ghpythonlib.treehelpers import list_to_tree

import compas_cgal

print(compas_cgal.__version__)

#get current file path
path = ghenv.Component.OnPingDocument().FilePath
print (path)
#get parent directory of the parent directory
parentdir = os.path.dirname(path)
print (parentdir)
#get src folder which contains classes
dire = os.path.join(parentdir,'src')
print (dire)

sys.path.append(dire)

unload_modules('branch')
unload_modules('mesh_utils')
unload_modules('graph_utils')
unload_modules('growth_center')


from branch import Branch
import mesh_utils
import graph_utils
import growth_center

skeleton_trunk = branch.skeleton_trunk_lines()
skeleton_axis_1, skeleton_axis_2 = branch.skeleton_branching_lines()
skeleton = [skeleton_trunk, skeleton_axis_1, skeleton_axis_2]

skeleton_bifurcation_pt = branch.bifurcation_point()

computed_bifurcation_pt = branch.compute_bifurcation_point(tolerance=5.0)

bifurcation_angle = branch.skeleton_bifurcation_angle()

bifurcation_graph = branch.true_bifurcation_graph_lines()

contours_dict = branch._contours(graph=branch.true_bifurcation_graph(), resolution=30.0)
contours = [contours_dict[0], contours_dict[1], contours_dict[2]]
contours = list_to_tree(contours)

_, max_inscribed_circles = branch.growth_centerline()
max_inscribed_circles = list_to_tree(max_inscribed_circles)
# ---------- end debug ----------
centerline = Python3Script(branch=preprocess.branch)  # -> out, geometric_centerline, geometric_sections, growth_centerline, circular_section, section_diameter, bifurcation_point
# ---------- centerline: Python ----------
#locate file in the same folder
from compas_rhino import unload_modules
from compas_rhino.conversions import mesh_to_compas, vector_to_rhino, point_to_rhino
import sys
import os

from ghpythonlib.treehelpers import list_to_tree

import compas_cgal

print(compas_cgal.__version__)

#get current file path
path = ghenv.Component.OnPingDocument().FilePath
print (path)
#get parent directory of the parent directory
parentdir = os.path.dirname(path)
print (parentdir)
#get src folder which contains classes
dire = os.path.join(parentdir,'src')
print (dire)

sys.path.append(dire)

unload_modules('branch')
unload_modules('mesh_utils')
unload_modules('graph_utils')
unload_modules('growth_center')


from branch import Branch
import mesh_utils
import graph_utils
import growth_center

from compas.geometry import Polyline, Line


bifurcation_point = branch.compute_bifurcation_point()

geometric_centerline, sections_geometric = branch.geometric_centerline()
growth_centerline, sections_circular = branch.growth_centerline()
geometric_section = list_to_tree(sections_geometric)
section_diameter = []
for axis in sections_circular:
    axis_diameters = []
    for c in axis:
        axis_diameters.append(c.radius * 2)
    section_diameter.append(axis_diameters)

circular_section = list_to_tree(sections_circular)
section_diameter = list_to_tree(section_diameter)
# ---------- end centerline ----------
compas_draw_6 = COMPASDraw(cg=centerline.geometric_centerline)  # -> rg; same code as compas_draw
compas_draw_7 = COMPASDraw(cg=centerline.geometric_sections)  # -> rg; same code as compas_draw
compas_draw_8 = COMPASDraw(cg=centerline.growth_centerline)  # -> rg; same code as compas_draw
compas_draw_9 = COMPASDraw(cg=centerline.circular_section)  # -> rg; same code as compas_draw
compas_draw_10 = COMPASDraw(cg=centerline.bifurcation_point)  # -> rg; same code as compas_draw
compas_draw_11 = COMPASDraw(cg=debug.skeleton)  # -> rg; same code as compas_draw
compas_draw_12 = COMPASDraw(cg=debug.skeleton_bifurcation_pt)  # -> rg; same code as compas_draw
compas_draw_13 = COMPASDraw(cg=debug.computed_bifurcation_pt)  # -> rg; same code as compas_draw
panel_3 = Panel(debug.bifurcation_angle)
compas_draw_14 = COMPASDraw(cg=debug.bifurcation_graph)  # -> rg; same code as compas_draw
compas_draw_15 = COMPASDraw(cg=debug.contours)  # -> rg; same code as compas_draw
compas_draw_16 = COMPASDraw(cg=debug.max_inscribed_circles)  # -> rg; same code as compas_draw
panel_4 = Panel(centerline.section_diameter)
geometry = Geometry([<curve referenced from the Rhino model> x243])
list_item_2 = ListItem(List=geometry, Index=Slider(0, range=0..100), Wrap=True)
python_3_script_2 = Python3Script(pl=geometry)  # -> out, polylines, nodes; inputs pl: list of Line
# ---------- python_3_script_2: Python ----------
from compas.datastructures import Graph
from compas_rhino.conversions import line_to_compas
from compas.geometry import Line
import numpy as np

from compas.geometry import distance_point_point, Point


cpl = [line_to_compas(l) for l in pl]

# ============================================================
# GRAPH CONSTRUCTION
# ============================================================

def graph_from_polylines(polylines):
    """
    Construct a graph from a list of polylines and repair connectivity.

    Parameters
    ----------
    polylines : list
        List of COMPAS polylines.

    Returns
    -------
    Graph
        Repaired COMPAS graph.
    """
    edges = [(tuple(line.start), tuple(line.end)) for line in polylines]
    graph = Graph.from_edges(edges)
    graph = repair_graph_by_tolerance(graph)
    return graph


# ============================================================
# GRAPH REPAIR
# ============================================================

def repair_graph_by_tolerance(graph, tol=1.0):
    """
    Connect nodes that are within a given Euclidean tolerance.
    """

    repaired = Graph()

    # copy nodes
    for node in graph.nodes():
        repaired.add_node(node)

    # copy edges
    for u, v in graph.edges():
        repaired.add_edge(u, v)

    nodes = list(graph.nodes())

    # spatial stitching
    for i, u in enumerate(nodes):
        pu = Point(*u)

        for j in range(i + 1, len(nodes)):
            v = nodes[j]

            if graph.has_edge((u, v)) or graph.has_edge((v, u)):
                continue

            pv = Point(*v)

            if distance_point_point(pu, pv) <= tol:
                repaired.add_edge(u, v)

    return repaired


# ============================================================
# BIFURCATION DETECTION
# ============================================================

def find_bifurcation_candidates(graph):
    return [node for node in graph.nodes() if graph.degree(node) == 3]


def get_next_edges(graph, current, prev):
    edges = graph.node_edges(current)
    result = []

    for edge in edges:
        u, v = edge
        nxt = v if u == current else u

        if nxt != prev:
            result.append((edge, nxt))

    return result


# ============================================================
# GEOMETRIC UTILITIES
# ============================================================

def edge_length(graph, u, v):
    return distance_point_point(Point(*u), Point(*v))


def edge_length_from_edge(graph, edge):
    u, v = edge
    return edge_length(graph, u, v)


# ============================================================
# BRANCH WALKING
# ============================================================

def walk_branch(graph, start, first_edge):
    """
    Walk a branch and return longest valid path + length.
    """

    u, v = first_edge
    neighbor = v if u == start else u

    best_path = []
    best_length = 0.0

    stack = [
        (
            neighbor,
            start,
            [start, neighbor],
            edge_length_from_edge(graph, first_edge),
        )
    ]

    while stack:
        current, prev, path, length = stack.pop()
        degree = graph.degree(current)

        # leaf node
        if degree == 1:
            if length > best_length:
                best_path = path
                best_length = length
            continue

        next_edges = get_next_edges(graph, current, prev)

        # straight continuation
        if degree == 2 and len(next_edges) == 1:
            edge, nxt = next_edges[0]

            stack.append(
                (
                    nxt,
                    current,
                    path + [nxt],
                    length + edge_length_from_edge(graph, edge),
                )
            )

        # noisy branching
        else:
            for edge, nxt in next_edges:
                if nxt in path:
                    continue

                stack.append(
                    (
                        nxt,
                        current,
                        path + [nxt],
                        length + edge_length_from_edge(graph, edge),
                    )
                )

    return best_path, best_length


# ============================================================
# CANDIDATE EVALUATION
# ============================================================

def evaluate_candidate(graph, node):
    edges = graph.node_edges(node)

    paths = []
    total_length = 0.0

    for edge in edges:
        path, length = walk_branch(graph, node, edge)
        paths.append(path)
        total_length += length

    return paths, total_length


def find_best_bifurcation(graph):
    candidates = find_bifurcation_candidates(graph)

    best_node = None
    best_paths = None
    best_length = -1

    for node in candidates:
        paths, total_length = evaluate_candidate(graph, node)

        if total_length > best_length:
            best_node = node
            best_paths = paths
            best_length = total_length

    return best_node, best_paths, best_length


# ============================================================
# OUTPUT UTILITIES
# ============================================================

def paths_to_graph(paths):
    g = Graph()

    for path in paths:
        for i in range(len(path) - 1):
            u = path[i]
            v = path[i + 1]

            if not g.has_node(u):
                g.add_node(u)

            if not g.has_node(v):
                g.add_node(v)

            if not g.has_edge((u, v)):
                g.add_edge(u, v)

    return g


graph = graph_from_polylines(cpl)
nodes = [Point(*n) for n in find_bifurcation_candidates(graph)]

# for e in graph.edges():
#     print(edge_length_from_edge(graph, e))

node, best_paths, best_length = find_best_bifurcation(graph)
best_graph = paths_to_graph(best_paths)

polylines = []
for e in best_graph.edges():
        polylines.append(Line(*e))
# ---------- end python_3_script_2 ----------
compas_draw_17 = COMPASDraw(cg=python_3_script_2.nodes)  # -> rg; same code as compas_draw
list_item_3 = ListItem(List=compas_draw_17, Index=0, Wrap=True)
compas_draw_18 = COMPASDraw(cg=python_3_script_2.polylines)  # -> rg; same code as compas_draw
python_3_script_3 = Python3Script(pl=geometry)  # -> out, nodes; inputs pl: list of Line
# ---------- python_3_script_3: Python ----------
from compas.datastructures import Graph
from compas_rhino.conversions import line_to_compas
from compas.geometry import Line
import numpy as np

from compas.geometry import distance_point_point, Point


cpl = [line_to_compas(l) for l in pl]

def graph_from_polylines(polylines):
    """Construct a graph from a list of polylines.

    Parameters
    ----------
    polylines : list of compas.geometry.Polyline
        The input polylines.

    Returns
    -------
    dict
        A graph represented as an adjacency list, where keys are points and values are lists of connected points.
    """
    graph = Graph.from_edges([(tuple(line.start), tuple(line.end)) for line in polylines])
    return graph




def find_bifurcation_candidates(graph):
    return [node for node in graph.nodes() if graph.degree(node) == 3]


graph = graph_from_polylines(cpl)
nodes = [Point(*n) for n in find_bifurcation_candidates(graph)]

# for e in graph.edges():
#     print(edge_length_from_edge(graph, e))

# nodes, best_paths, best_length = find_best_bifurcation(graph)
# best_graph = paths_to_graph(best_paths)

# polylines = []
# for e in best_graph.edges():
#         polylines.append(Line(*e))
# ---------- end python_3_script_3 ----------
compas_draw_19 = COMPASDraw(cg=python_3_script_3.nodes)  # -> rg; same code as compas_draw
